# Grasshopper definition 004_007_001_Constant_Function.gh (Grasshopper 1.0.7)
# plug-ins: RhinoCodePluginGH

# ----
# Visualize Mathematics
# with Python in Grasshopper
# at Wickerson Studios
# Part 4: Algebra and Arithmetic
# 4.7 COMMON FUNCTIONS
# 004_007_001_Constant Function
# gpt-4 Text Prompt
# Create a geometric 3D model with
# 
# MATHEMATICS
# AREA, VOULUME AND SURFACE AREA
# 
# to create a 3D model specifically about
# 
# Common Functions: Constant Function
# y=a or f(x)=a
# x=a
# 
# 
# in python 3 code for the python 3 script
# node in grasshopper for Rhino8WIP using the
# Rhino Common API to create some geometry as well.
# 
# Output the parts of the model in different
# variable outputs in the python 3 node in
# grasshopper.
# PARAMETRIC SCRIPT PROMPT
# Make this parametric and suggest the inputs
# and list the input data types.
# BASIC SCRIPT
# ADVANCED SCRIPT
number_slider = Slider(10, range=0..10)  # disabled
number_slider_2 = Slider(0, range=0..10)  # disabled
number_slider_3 = Slider(6, range=0..20)  # disabled
# 2nd gpt-4 Text Prompt
# Great, now make the script much more complex model
# with NUMPY python library.
# Be sure to incorporate the previous code logic.
# ensure that this script produces 3d geometry as
# well for Data visualization purposes.
number_slider_4 = Slider(7.35, range=0..10)  # disabled
# gpt-4 Transcript link:
# 
# https://chat.openai.com/share/e6691b7a-d657-4d9c-9f26-54f22ee49771
number_slider_5 = Slider(10, range=0..10)
constant_function = Script(const_y=number_slider, const_x=number_slider_2, num_planes=number_slider_3, dist=number_slider_4)  # -> out, a, b; inputs const_y: Double, const_x: Double, num_planes: Int32, dist: Double; disabled
# ---------- constant_function: Python ----------
import Rhino.Geometry as rg

# Assume 'const_y' and 'const_x' are input parameters representing the constant values for y and x respectively
# 'num_planes' is the number of planes you want to create
# 'dist' is the distance between the planes

# List to hold the created planes
planes_y = []
planes_x = []

# Create planes at constant y value
for i in range(num_planes):
    origin = rg.Point3d(0, const_y, i * dist)  # x=0, y=const_y, z varies to arrange the planes along z-axis
    normal = rg.Vector3d(0, 1, 0)  # Normal along y-axis
    planes_y.append(rg.Plane(origin, normal))

# Create a plane at constant x value
origin_x = rg.Point3d(const_x, 0, 0)  # x=const_x, y=0, z=0
normal_x = rg.Vector3d(1, 0, 0)  # Normal along x-axis
planes_x.append(rg.Plane(origin_x, normal_x))

# Output the planes
a = planes_y
b = planes_x
# ---------- end constant_function ----------
constant_function_2 = Script(
    const_y=Slider(10, range=0..10),
    const_x=Slider(10, range=0..10),
    num_planes=Slider(4, range=0..20),
    dist=number_slider_5)  # -> out, a; inputs const_y: Double, const_x: Double, num_planes: Int32, dist: Double
# ---------- constant_function_2: Python ----------
import Rhino.Geometry as rg
import numpy as np

# List to hold the created sphere geometries
sphere_geometries = []

# Create planes at constant y value and generate 3D points field
for i in range(num_planes):
    z_val = i * dist  # z varies to arrange the planes along z-axis
    origin_y = rg.Point3d(0, const_y, z_val)  # x=0, y=const_y, z=z_val
    normal_y = rg.Vector3d(0, 1, 0)  # Normal along y-axis
    plane_y = rg.Plane(origin_y, normal_y)

    # Create a 2D numpy array of x, z coordinates representing points on this plane
    x = np.linspace(-10, 10, 10)  # Example range and number of points, adjust as needed
    z = np.full_like(x, z_val)

    # Combine the x, const_y, and z to make 3D points and create sphere geometries at those locations
    for xi, zi in zip(x, z):
        point = rg.Point3d(xi, const_y, zi)
        sphere = rg.Sphere(point, 1)  # 1 is the radius of the sphere, adjust as needed
        sphere_geometries.append(sphere.ToBrep())  # Convert sphere to Brep geometry before adding to list

# Create a plane at constant x value and generate spheres on this plane
origin_x = rg.Point3d(const_x, 0, 0)  # x=const_x, y=0, z=0
normal_x = rg.Vector3d(1, 0, 0)  # Normal along x-axis
plane_x = rg.Plane(origin_x, normal_x)

# Create a 2D numpy array of y, z coordinates representing points on this plane
y = np.linspace(-10, 10, 10)  # Example range and number of points, adjust as needed
z = np.linspace(-10, 10, 10)  # Example range and number of points, adjust as needed

# Combine the const_x, y, and z to make 3D points and create sphere geometries at those locations
for yi, zi in zip(y, z):
    point = rg.Point3d(const_x, yi, zi)
    sphere = rg.Sphere(point, 1)  # 1 is the radius of the sphere, adjust as needed
    sphere_geometries.append(sphere.ToBrep())  # Convert sphere to Brep geometry before adding to list

# Output the geometries
a = sphere_geometries
# ---------- end constant_function_2 ----------
# gpt-4 Initial Response
# Creating a 3D model using Rhino Common API
# in Grasshopper's Python component involves
# specifying geometric entities and using their
# respective Rhino Common API calls. The
# following is a simple demonstration of how you
# might do this using a constant function.
# 
# The Python component in Grasshopper usually
# has x as an input, and a as the output, but you
# can change these or add more as per your
# needs.
# 
# Below is an example Python 3 code snippet
# which creates a series of planes (as 3D
# geometric entities) at constant y value (which is
# a simple representation of a constant function y
# = a), and at a specific x (a representation of x =
# a), showing both are constant functions in 3D
# space.
panel = Panel(constant_function.out)  # disabled
# gpt-4 Advanced Response
# To integrate NUMPY and make the script more
# advanced, we can consider creating a 3D field
# of points derived from the original logic of
# creating planes. These points can then be used
# to generate other 3D geometries like spheres,
# for visualization purposes.
# 
# Below is an example of a more complex Python
# script which uses numpy to create a 3D array of
# points in space derived from the position of the
# planes from the previous example. We'll then
# create spheres at each of these point locations.
#  This code retains the logic from the previous
# example, adding complexity and utilizing numpy
# for enhanced mathematical operations.
plane = Plane(constant_function.b)  # disabled
plane_2 = Plane(constant_function.a)  # disabled
panel_2 = Panel(constant_function_2.out)
geometry = Geometry(constant_function_2.a)
entwine = Entwine(Branch00=plane_2, Branch01=plane, FlattenInputs=True)  # disabled
point = Point(plane_2)  # disabled
entwine_2 = Entwine(Branch00=geometry, FlattenInputs=True)
interpolate = Interpolate(Vertices=point, Degree=3, Periodic=False, KnotStyle=1)  # -> Curve, Length, Domain; disabled
panel_3 = Panel(entwine)  # disabled
panel_4 = Panel(entwine_2)

# ----
# Visualize Mathematics
# with C# in Grasshopper
# at Wickerson Studios
# Part 4: Algebra and Arithmetic
# 4.7 COMMON FUNCTIONS
# 004_007_001_Constant Function
# gpt-4 Text Prompt
# Use this script editor template to create a script
#  for the C# node in grasshopper for rhino8 that
# models geometry for the
# 
# ALGEBRA AND ARITHMETIC
# 
# and specifically the
# 
# 
# Common Functions: Constant Function
# y=a or f(x)=a
# x=a
# 
# 
# 
# //Grasshopper Script Instance
# //#! csharp
# using System;
# using System.Collections;
# using System.Collections.Generic;
# using System.Drawing;
# 
# using Rhino;
# using Rhino.Geometry;
# 
# using Grasshopper;
# using Grasshopper.Kernel;
# using Grasshopper.Kernel.Data;
# using Grasshopper.Kernel.Types;
# 
# public class Script_Instance : GH_ScriptInstance
# {
#   /*
#     Members:
#       RhinoDoc RhinoDocument
#       GH_Document GrasshopperDocument
#       IGH_Component Component
#       int Iteration
# 
#     Methods (Virtual & overridable):
#       Print(string text)
#       Print(string format, params object[] args)
#       Reflect(object obj)
#       Reflect(object obj, string method_name)
#   */
# 
#   private void RunScript(object x, object y, out object a)
#   {
#     // Write your logic here
#     a = null;
#   }
# }
# BASIC SCRIPT
# ADVANCED  SCRIPT
number_slider_6 = Slider(0, range=0..100)  # disabled
# gpt-4 Initial Response
# 2nd gpt-4 Text Prompt
# Certainly! To make a more complex model, we
# can extend the functionality to create 3D
# geometries for data visualization. We can create
#  planes at each constant position and then
# create 3D rectangles (box geometries) in those
# planes based on provided data values.
# 
# We can visualize the data by assigning heights
# to the boxes, representing the magnitude of
# some data points. Below is the updated C#
# script to achieve that.
# 
# This script will create a series of boxes on either
# the constant x or y plane, where the height of
# each box represents a data point in the list. The
# range of x or y is determined by the domain.
# Each box will be positioned at the data point's
# index and will have a height corresponding to
# the data point's value.
# Great, now make the script much more complex model
# with C# script and Rhino common API.
# 
# Be sure to incorporate the previous code logic.
# ensure that this script produces 3d geometry as
# well for Data visualization purposes.
number_slider_7 = Slider(14.21, range=0..100)  # disabled
# gpt-4 Transcript link:
# 
# https://chat.openai.com/share/c8e2edb5-38fb-4c36-ba09-9f00fad0f796
number_slider_8 = Slider(57.64, range=0..100)
number_slider_9 = Slider(16.76, range=0..100)  # disabled
construct_domain = ConstructDomain(DomainStart=number_slider_6, DomainEnd=number_slider_7)  # disabled
# gpt-4 Initial Response
# Given the provided template, I'll help you
# develop a script for the C# node in Grasshopper
#  for Rhino 8 that models the constant function
# y=a or f(x)=a and x=a.
# 
# I'll assume the following requirements:
# 
# For the function y=a, the user will input a
# constant value a, and the script will create a
# horizontal line segment at that height with
# endpoints specified by a given range of x.
# 
# For the function x=a, the user will again input a
# constant value a, and the script will create a
# vertical line segment at that position with
# endpoints specified by a given range of y
boolean_toggle = BooleanToggle(True)  # disabled
construct_domain_2 = ConstructDomain(DomainStart=Slider(0, range=0..100), DomainEnd=number_slider_8)
constant_function_3 = Script(isYConstant=boolean_toggle, a=number_slider_9, range=construct_domain)  # -> out, line; inputs isYConstant: Boolean, a: Double; disabled
# ---------- constant_function_3: C# ----------
using System;
using System.Collections.Generic;

using Rhino;
using Rhino.Geometry;

using Grasshopper;
using Grasshopper.Kernel;

public class Script_Instance : GH_ScriptInstance
{
  // ...
  
  private void RunScript(bool isYConstant, double a, Rhino.Geometry.Interval range, out object line)
  {
    if (isYConstant)
    {
      // If y is constant (y = a)
      line = new Line(new Point3d(range.Min, a, 0), new Point3d(range.Max, a, 0));
    }
    else
    {
      // If x is constant (x = a)
      line = new Line(new Point3d(a, range.Min, 0), new Point3d(a, range.Max, 0));
    }
  }
}
# ---------- end constant_function_3 ----------
constant_function_4 = Script(isYConstant=Toggle(False), a=Slider(15.51, range=0..100), range=construct_domain_2, interval=Slider(6.2, range=1..10))  # -> out, lines; inputs isYConstant: Boolean, a: Double, interval: Double
# ---------- constant_function_4: C# ----------
using System;
using System.Collections.Generic;
using Rhino;
using Rhino.Geometry;
using Grasshopper;
using Grasshopper.Kernel;

public class Script_Instance : GH_ScriptInstance
{
  // Added new method to generate grid of lines
  private List<Line> GenerateGrid(Rhino.Geometry.Interval xRange, Rhino.Geometry.Interval yRange, double interval)
  {
    List<Line> lines = new List<Line>();
    
    // Horizontal lines
    for (double y = yRange.Min; y <= yRange.Max; y += interval)
    {
      lines.Add(new Line(new Point3d(xRange.Min, y, 0), new Point3d(xRange.Max, y, 0)));
    }
    
    // Vertical lines
    for (double x = xRange.Min; x <= xRange.Max; x += interval)
    {
      lines.Add(new Line(new Point3d(x, yRange.Min, 0), new Point3d(x, yRange.Max, 0)));
    }
    
    return lines;
  }
  
  private void RunScript(bool isYConstant, double a, Rhino.Geometry.Interval range, double interval, out object lines)
  {
    if (isYConstant)
    {
      // If y is constant (y = a), generate vertical lines.
      lines = GenerateGrid(new Interval(range.Min, range.Max), new Interval(a, a + interval), interval);
    }
    else
    {
      // If x is constant (x = a), generate horizontal lines.
      lines = GenerateGrid(new Interval(a, a + interval), new Interval(range.Min, range.Max), interval);
    }
  }
}
# ---------- end constant_function_4 ----------
panel_5 = Panel(constant_function_3.out)  # disabled
geometry_2 = Geometry(constant_function_3.line)  # disabled
panel_6 = Panel(constant_function_4.out)
geometry_3 = Geometry(constant_function_4.lines)
entwine_3 = Entwine(Branch00=geometry_2, FlattenInputs=True)  # disabled
entwine_4 = Entwine(Branch00=geometry_3, FlattenInputs=True)
panel_7 = Panel(entwine_3)  # disabled
panel_8 = Panel(entwine_4)
