# Grasshopper definition 004_007_002_Line_Linear_Function.gh (Grasshopper 1.0.7)
# plug-ins: RhinoCodePluginGH

# ----
# PARAMETRIC SCRIPT PROMPT
# Make this parametric and suggest the inputs
# and list the input data types.
# BASIC SCRIPT
# z = mx + c,
# ADVANCED SCRIPT
number_slider = Slider(5.28, range=0..20)  # disabled
# 2nd gpt-4 Text Prompt
# Great, now make the script much more complex model
# with NUMPY python library.
# Be sure to incorporate the previous code logic.
# ensure that this script produces 3d geometry as
# well for Data visualization purposes.
number_slider_2 = Slider(10, range=0..10)  # disabled
# gpt-4 Transcript link:
# 
# https://chat.openai.com/share/0bebe4ac-16ac-40b6-a196-7085514511ad
number_slider_3 = Slider(10, range=0..10)
# Visualize Mathematics
# with Python in Grasshopper
# at Wickerson Studios
# Part 4: Algebra and Arithmetic
# 4.7 COMMON FUNCTIONS
# 004_007_002_Line_Linear_Function
# gpt-4 Text Prompt
# Create a geometric 3D model with
# 
# MATHEMATICS
# AREA, VOULUME AND SURFACE AREA
# 
# to create a 3D model specifically about
# 
# Common Functions: Line Linear Function
# y = mx + c
# 
# 
# in python 3 code for the python 3 script
# node in grasshopper for Rhino8WIP using the
# Rhino Common API to create some geometry as well.
# 
# Output the parts of the model in different
# variable outputs in the python 3 node in
# grasshopper.
number_slider_4 = Slider(4.88, range=0..10)  # disabled
number_slider_5 = Slider(0, range=0..10)  # disabled
construct_domain = ConstructDomain(DomainStart=0, DomainEnd=number_slider)  # disabled
# gpt-4 Advanced Response
# To integrate NUMPY and make the script more
# advanced, we can consider creating a 3D field
# of points derived from the original logic of
# creating planes. These points can then be used
# to generate other 3D geometries like spheres,
# for visualization purposes.
# 
# Below is an example of a more complex Python
# script which uses numpy to create a 3D array of
# points in space derived from the position of the
# planes from the previous example. We'll then
# create spheres at each of these point locations.
#  This code retains the logic from the previous
# example, adding complexity and utilizing numpy
# for enhanced mathematical operations.
construct_domain_2 = ConstructDomain(DomainStart=0, DomainEnd=number_slider_2)  # disabled
construct_domain_3 = ConstructDomain(DomainStart=0, DomainEnd=Slider(5.28, range=0..20))
construct_domain_4 = ConstructDomain(DomainStart=0, DomainEnd=number_slider_3)
line_linear_function = Script(m=number_slider_4, c=number_slider_5, x_dom=construct_domain, y_dom=construct_domain_2)  # -> out, a, b; inputs m: Double, c: Double; disabled
# ---------- line_linear_function: Python ----------
import Rhino.Geometry as rg

# Validate if domains are correct
if x_dom[0] >= x_dom[1] or y_dom[0] >= y_dom[1]:
    raise ValueError("Invalid domain values")

# Calculate 4 corner points of the plane within the specified domain
pt1 = rg.Point3d(x_dom[0], y_dom[0], m * x_dom[0] + c)
pt2 = rg.Point3d(x_dom[1], y_dom[0], m * x_dom[1] + c)
pt3 = rg.Point3d(x_dom[1], y_dom[1], m * x_dom[1] + c)
pt4 = rg.Point3d(x_dom[0], y_dom[1], m * x_dom[0] + c)

# Create a plane from the 4 corner points
plane_surface = rg.Brep.CreateFromCornerPoints(pt1, pt2, pt3, pt4, 0.01)

if not plane_surface:
    raise ValueError("Failed to create the plane")

# Output the Plane
a = plane_surface

# Calculate Area
area = rg.AreaMassProperties.Compute(plane_surface).Area

# Output the Area
b = area
# ---------- end line_linear_function ----------
line_linear_function_2 = Script(m=Slider(4.88, range=0..10), c=Slider(0, range=0..10), x_dom=construct_domain_3, y_dom=construct_domain_4)  # -> out, a, b; inputs m: Double, c: Double; same code as line_linear_function
# gpt-4 Initial Response
# Creating a Python script for Grasshopper within
# Rhino involves utilizing Rhino’s API,
# RhinoScriptSyntax, or rhinoscriptsyntax, which is
#  a scripting interface for Rhino, along with
# RhinoCommon.
# 
# Given that y=mx+c is a 2D line equation, and we
#  are to create a 3D model, we can extrapolate
# this equation into 3D space by adding a z term,
# such as z = mx + c, to get a plane in 3D space.
# 
# Below is an example Python script to create a
# plane from a linear equation in Rhino’s
# Grasshopper. This is a simple representation,
# and you can modify it based on your
# requirements. The script assumes that m, c, and
#  domain for x and y values are provided as
# inputs to the Grasshopper node.
panel = Panel(line_linear_function.out)  # disabled
plane = Plane(line_linear_function.a)  # disabled
panel_2 = Panel(line_linear_function_2.out)
plane_2 = Plane(line_linear_function_2.a)
entwine = Entwine(Branch00=plane, Branch01=line_linear_function.b, FlattenInputs=True)  # disabled
entwine_2 = Entwine(Branch00=plane_2, Branch01=line_linear_function_2.b, FlattenInputs=True)
# Visualize Mathematics
# with C# in Grasshopper
# at Wickerson Studios
# Part 4: Algebra and Arithmetic
# 4.7 COMMON FUNCTIONS
# 004_007_001_Constant Function
# gpt-4 Text Prompt
# Use this script editor template to create a script
#  for the C# node in grasshopper for rhino8 that
# models geometry for the
# 
# ALGEBRA AND ARITHMETIC
# 
# and specifically the
# 
# 
# Common Functions:
# Common Functions: Line Linear Function
# y = mx + c
# 
# 
# 
# //Grasshopper Script Instance
# //#! csharp
# using System;
# using System.Collections;
# using System.Collections.Generic;
# using System.Drawing;
# 
# using Rhino;
# using Rhino.Geometry;
# 
# using Grasshopper;
# using Grasshopper.Kernel;
# using Grasshopper.Kernel.Data;
# using Grasshopper.Kernel.Types;
# 
# public class Script_Instance : GH_ScriptInstance
# {
#   /*
#     Members:
#       RhinoDoc RhinoDocument
#       GH_Document GrasshopperDocument
#       IGH_Component Component
#       int Iteration
# 
#     Methods (Virtual & overridable):
#       Print(string text)
#       Print(string format, params object[] args)
#       Reflect(object obj)
#       Reflect(object obj, string method_name)
#   */
# 
#   private void RunScript(object x, object y, out object a)
#   {
#     // Write your logic here
#     a = null;
#   }
# }
panel_3 = Panel(entwine)  # disabled
panel_4 = Panel(entwine_2)

# ----
# BASIC SCRIPT
# You are correct, ConvertAll is not available on
# IEnumerable<double>, it is a method of List<T>.
#  If xValues is an IEnumerable<double> (likely
# because the input is in list access mode), you
# might want to use LINQ.
# 
# Here’s how you can use LINQ to convert
# xValues to a list of Point3d without using Add
# method:
# ADVANCED  SCRIPT
# gpt-4 Transcript link:
# 
# https://chat.openai.com/share/8b6b3276-5758-4aef-9c67-6172a94041d6
panel_5 = Panel("-2")
number_slider_6 = Slider(1.04, range=0..10)  # disabled
# gpt-4 Initial Response
# 2nd gpt-4 Text Prompt
# Certainly! Below is a more complex example that
#  will utilize the previous logic to create a 3D
# visualization based on the linear function
# y=mx+c. This will create a 3D surface plot using
# lines, where the x-axis is the input range of x-
# values, the y-axis is the resultant y-values from
# the linear equation, and the z-axis is, for
# example, squared y-values for data visualization.
# 
# This script will draw a 3D curve for each x-value,
# based on the linear function, and then loft these
#  curves to create a surface. Here’s how to go
# about this:
# Great, now make the script much more complex model
# with C# script and Rhino common API.
# 
# Be sure to incorporate the previous code logic.
# ensure that this script produces 3d geometry as
# well for Data visualization purposes.
number_slider_7 = Slider(7.12, range=0..10)  # disabled
# gpt-4 Initial Response
# The provided template is a basic skeleton for
# writing a C# script in the Grasshopper
# environment for Rhino. For the problem at hand,
#  which is to create a script that models the linear
#  function
# y=mx+c, I'll need more specifics about the
# intended visualization or usage.
# 
# But, for the sake of demonstration, let's say we want to generate a line in Rhino based on the equation
# y=mx+c. For this:
# 
# We'll take x as an input, which will be a range of
# values.
# We'll also take m (slope) and c (y-intercept) as
# inputs.
# The output a will be a list of 3D points that lie on
#  the line described by the linear function.
panel_6 = Panel("-10")  # disabled
panel_7 = Panel("21")  # disabled
multiplication = Multiplication(A="-5", B=panel_5)
series = Series(Start=panel_6, Step=1, Count=panel_7)  # disabled
series_2 = Series(Start="-5", Step=1, Count=multiplication)
line_linear_function_3 = Script(xValues=series, m=number_slider_6, c=number_slider_7)  # -> out, a; inputs xValues: list of Double, m: Double, c: Double; disabled
# ---------- line_linear_function_3: C# ----------
using System;
using System.Collections;
using System.Collections.Generic;
using System.Drawing;

using Rhino;
using Rhino.Geometry;

using Grasshopper;
using Grasshopper.Kernel;
using Grasshopper.Kernel.Data;
using Grasshopper.Kernel.Types;

using System;
using System.Collections.Generic;
using Rhino.Geometry;

using System;
using System.Collections.Generic;
using System.Linq; // Required for LINQ
using Rhino.Geometry;

public class Script_Instance : GH_ScriptInstance
{
    private void RunScript(System.Collections.Generic.IEnumerable<double> xValues, double m, double c, out object a)
    {
        a = xValues.Select(x => new Point3d(x, m * x + c, 0)).ToList();
    }
}
# ---------- end line_linear_function_3 ----------
line_linear_function_4 = Script(xValues=series_2, m=Slider(0.99, range=0..10), c=Slider(1.52, range=0..10))  # -> out, curves; inputs xValues: list of Double, m: Double, c: Double
# ---------- line_linear_function_4: C# ----------
using System;
using System.Collections;
using System.Collections.Generic;
using System.Drawing;

using Rhino;
using Rhino.Geometry;

using Grasshopper;
using Grasshopper.Kernel;
using Grasshopper.Kernel.Data;
using Grasshopper.Kernel.Types;

using System;
using System.Collections.Generic;
using System.Linq;
using Rhino.Geometry;

public class Script_Instance : GH_ScriptInstance
{
    private void RunScript(System.Collections.Generic.IEnumerable<double> xValues, double m, double c, out object curves)
    {
        // Initialize the curves list and surface.
        curves = new List<Curve>();
        
        // Validate xValues before proceeding.
        if(xValues != null && xValues is List<double> validXValues && validXValues.Count > 0)
        {
            List<Point3d> points = validXValues.Select(x => new Point3d(x, m * x + c, 0)).ToList();
            curves = points.Select(pt => new LineCurve(pt, new Point3d(pt.X, pt.Y, Math.Pow(pt.Y, 2)))).ToList();
        }
    }
}
# ---------- end line_linear_function_4 ----------
panel_8 = Panel(line_linear_function_3.out)  # disabled
geometry = Geometry(line_linear_function_3.a)  # disabled
geometry_2 = Geometry(line_linear_function_4.curves)
panel_9 = Panel(line_linear_function_4.out)
entwine_3 = Entwine(Branch00=geometry, FlattenInputs=True)  # disabled
entwine_4 = Entwine(Branch00=geometry_2, FlattenInputs=True)
panel_10 = Panel(entwine_3)  # disabled
panel_11 = Panel(entwine_4)
