# Grasshopper definition 004_007_003_Circle.gh (Grasshopper 1.0.7)
# plug-ins: RhinoCodePluginGH

# ----
# PARAMETRIC SCRIPT PROMPT
# Make this parametric and suggest the inputs
# and list the input data types.
# BASIC SCRIPT
# ADVANCED SCRIPT
number_slider = Slider(11, range=0..100)
# gpt-4 Transcript link:
# https://chat.openai.com/share/512726ad-b0d3-43d1-948f-3a074302667d
number_slider_2 = Slider(0.2, range=0..10)
# Visualize Mathematics
# with Python in Grasshopper
# at Wickerson Studios
# Part 4: Algebra and Arithmetic
# 4.7 COMMON FUNCTIONS
# 004_007_003_Circle
# gpt-4 Text Prompt
# Create a geometric 3D model with
# 
# MATHEMATICS
# AREA, VOULUME AND SURFACE AREA
# 
# to create a 3D model specifically about
# 
# Common Functions: Circle
# (x-h)^2+(y-k)^2 = r^2
# 
# 
# in python 3 code for the python 3 script
# node in grasshopper for Rhino8WIP using the
# Rhino Common API to create some geometry as well.
# 
# Output the parts of the model in different
# variable outputs in the python 3 node in
# grasshopper.
number_slider_3 = Slider(9.73, range=0..10)  # disabled
number_slider_4 = Slider(4.66, range=0..10)  # disabled
# 2nd gpt-4 Text Prompt
# Great, now make the script much more complex model
# with NUMPY python library.
# Be sure to incorporate the previous code logic.
# ensure that this script produces 3d geometry as
# well for Data visualization purposes.
number_slider_5 = Slider(6.06, range=0..10)  # disabled
circle_function = Script(
    h=Slider(2.61, range=0..10),
    k=Slider(10, range=0..10),
    r=Slider(4.3, range=0..10),
    count=number_slider,
    multiplier=number_slider_2)  # -> out, A, B; inputs h: Double, k: Double, r: Double, count: Int32, multiplier: Double
# ---------- circle_function: Python ----------
import Rhino
import scriptcontext as sc
import numpy as np

# Inputs:
# h - Number, x-coordinate of the base center of the circle
# k - Number, y-coordinate of the base center of the circle
# r - Number, Base radius of the circle
# count - Number, count of spheres to be generated
# multiplier - Number, a value to multiply the radius for variability in sizes of spheres

# Validate the radius value
if r <= 0:
    raise ValueError("Radius must be a positive number.")

if count <= 0:
    raise ValueError("Count must be a positive number.")

if multiplier <= 0:
    raise ValueError("Multiplier must be a positive number.")

# Create a list to store the generated spheres and circles
spheres = []
circles = []

# Generate spheres and circles using NumPy
for i in range(count):
    # Generate random deviations for the center points
    deviation_hk = np.random.uniform(-r, r, 2)  # 2 values for x and y deviations
    deviation_r = np.random.uniform(0, r)  # radius deviation

    # Calculate the new center and radius
    center_point = Rhino.Geometry.Point3d(h + deviation_hk[0], k + deviation_hk[1], 0)
    new_radius = r + (multiplier * deviation_r)

    # Create sphere and circle using the new center and radius
    sphere = Rhino.Geometry.Sphere(center_point, new_radius)
    circle = Rhino.Geometry.Circle(center_point, new_radius)

    # Add to the lists
    spheres.append(sphere.ToNurbsSurface())  # Convert to NurbsSurface for output
    circles.append(circle.ToNurbsCurve())  # Convert to NurbsCurve for output

# Output:
# A - List of Sphere as the 3D geometric model
# B - List of Circles representing the base circle of the spheres
A = spheres
B = circles
# ---------- end circle_function ----------
circle_function_2 = Script(h=number_slider_3, k=number_slider_4, r=number_slider_5)  # -> out, A, B, C, D; inputs h: Double, k: Double, r: Double; disabled
# ---------- circle_function_2: Python ----------
import Rhino
import scriptcontext as sc

# Inputs:
# h - Number, x-coordinate of the center of the circle
# k - Number, y-coordinate of the center of the circle
# r - Number, Radius of the circle

# Validate the radius value
if r <= 0:
    raise ValueError("Radius must be a positive number.")

# Assuming z-coordinate to be 0 for the center of the circle.
center_point = Rhino.Geometry.Point3d(h, k, 0)

# Creating a Sphere using the center point and the radius
sphere = Rhino.Geometry.Sphere(center_point, r)

# Creating Circle on the xy plane, to represent base circle of the sphere
circle = Rhino.Geometry.Circle(center_point, r)

# Ensure the output Geometry is added to Rhino Document
# This step is crucial, or the geometry will not be visible in Rhino Viewport
sphere_id = sc.doc.Objects.AddSphere(sphere)
circle_id = sc.doc.Objects.AddCircle(circle)

# Output:
# A - Sphere as the 3D geometric model
# B - Center point of the sphere/circle
# C - Radius of the sphere/circle
# D - Circle representing the base circle of the sphere
A = sphere.ToNurbsSurface()  # Convert the sphere to Nurbs Surface for output
B = center_point
C = r
D = circle.ToNurbsCurve()  # Convert the circle to Nurbs Curve for output
# ---------- end circle_function_2 ----------
panel = Panel(circle_function.out)
geometry = Geometry(circle_function.A)
geometry_2 = Geometry(circle_function.B)
# gpt-4 Initial Response
# Creating a 3D model using Rhino Common API
# in Grasshopper's Python component involves
# specifying geometric entities and using their
# respective Rhino Common API calls. The
# following is a simple demonstration of how you
# might do this using a constant function.
# 
# The Python component in Grasshopper usually
# has x as an input, and a as the output, but you
# can change these or add more as per your
# needs.
# 
# Below is an example Python 3 code snippet
# which creates a series of planes (as 3D
# geometric entities) at constant y value (which is
# a simple representation of a constant function y
# = a), and at a specific x (a representation of x =
# a), showing both are constant functions in 3D
# space.
panel_2 = Panel(circle_function_2.out)  # disabled
geometry_3 = Geometry(circle_function_2.A)  # disabled
# gpt-4 Advanced Response
# Certainly! We can integrate the NumPy library to
#  generate a more complex and parametric
# model using multiple spheres, arranged in an
# interesting way, and ensuring that the final
# result is suitable for data visualization in 3D.
# 
# Below is an example Python script for
# Grasshopper, in which multiple spheres are
# created using NumPy to generate different
# centers and radii, ensuring that previous code
# logic is respected. This script will also visualize
# the 3D Geometry in Rhino:
geometry_4 = Geometry(circle_function_2.D)  # disabled
geometry_5 = Geometry(circle_function_2.B)  # disabled
entwine = Entwine(Branch00=geometry, Branch01=geometry_2, FlattenInputs=True)
panel_3 = Panel(entwine)
entwine_2 = Entwine(Branch00=geometry_3, Branch01=geometry_5, Branch02=circle_function_2.C, Branch03=geometry_4, FlattenInputs=True)  # disabled
panel_4 = Panel(entwine_2)  # disabled

# ----
# gpt-4 Transcript link:
# 
# https://chat.openai.com/share/a853f357-fcf5-436f-8017-2a3bb0ad7203
number_slider_6 = Slider(12, range=0..100)

# ----
# BASIC SCRIPT
# gpt-4 Initial Response
# 2nd gpt-4 Text Prompt
# To expand on the previous script and create a
# more complex 3D model using the
# RhinoCommon API, let’s visualize multiple
# circles in 3D space and connect them with lines.
# We will create a list of circles using different radii
# and centers, then create vertical lines
# connecting corresponding points on each
# adjacent pair of circles, thus forming a 3D visual.
# Great, now make the script much more complex model
# with C# script and Rhino common API.
# 
# Be sure to incorporate the previous code logic.
# ensure that this script produces 3d geometry as
# well for Data visualization purposes.
# ADVANCED  SCRIPT
number_slider_7 = Slider(0, range=0..10)
# Visualize Mathematics
# with C# in Grasshopper
# at Wickerson Studios
# Part 4: Algebra and Arithmetic
# 4.7 COMMON FUNCTIONS
# 004_007_003_Circle_C
# gpt-4 Initial Response
# gpt-4 Text Prompt
# Sure, if you want to create a script to model the
# geometry for a circle, you can input the center
# (h, k) and radius r of the circle, and then output
# the resulting Circle geometry. Here is a possible
# implementation in C# for a Grasshopper component.
# Use this script editor template to create a script
#  for the C# node in grasshopper for rhino8 that
# models geometry for the
# 
# ALGEBRA AND ARITHMETIC
# 
# and specifically the
# 
# 
# Common Functions: Circle
# (x-h)^2+(y-k)^2 = r^2
# 
# 
# //Grasshopper Script Instance
# //#! csharp
# using System;
# using System.Collections;
# using System.Collections.Generic;
# using System.Drawing;
# 
# using Rhino;
# using Rhino.Geometry;
# 
# using Grasshopper;
# using Grasshopper.Kernel;
# using Grasshopper.Kernel.Data;
# using Grasshopper.Kernel.Types;
# 
# public class Script_Instance : GH_ScriptInstance
# {
#   /*
#     Members:
#       RhinoDoc RhinoDocument
#       GH_Document GrasshopperDocument
#       IGH_Component Component
#       int Iteration
# 
#     Methods (Virtual & overridable):
#       Print(string text)
#       Print(string format, params object[] args)
#       Reflect(object obj)
#       Reflect(object obj, string method_name)
#   */
# 
#   private void RunScript(object x, object y, out object a)
#   {
#     // Write your logic here
#     a = null;
#   }
# }
number_slider_8 = Slider(2.12, range=0..10)  # disabled
number_slider_9 = Slider(1.71, range=0..10)  # disabled
number_slider_10 = Slider(3.2, range=0..10)  # disabled
circle_function_3 = Script(
    h=number_slider_7,
    k=Slider(0, range=0..10),
    z=Slider(5.31, range=0..10),
    minR=Slider(1.91, range=0..10),
    maxR=Slider(10, range=0..10),
    num=number_slider_6)  # -> out, Circles, Lines; inputs h: Double, k: Double, z: Double, minR: Double, maxR: Double, num: Int32
# ---------- circle_function_3: C# ----------
using System;
using System.Collections;
using System.Collections.Generic;
using System.Drawing;

using Rhino;
using Rhino.Geometry;

using Grasshopper;
using Grasshopper.Kernel;
using Grasshopper.Kernel.Data;
using Grasshopper.Kernel.Types;

using System;
using System.Collections.Generic;
using Rhino.Geometry;

public class Script_Instance : GH_ScriptInstance
{
  private void RunScript(double _h, double _k, double _z, double _minR, double _maxR, int _num, out object Circles, out object Lines)
  {
    // Type Conversion
    if (!(_h is double h) || !(_k is double k) || !(_z is double z) || !(_minR is double minR) || !(_maxR is double maxR) || !(_num is int num))
    {
      Circles = null;
      Lines = null;
      Print("Invalid input types. Please provide valid numbers.");
      return;
    }
    
    // Input Validation
    if(minR <= 0 || maxR <= 0 || num <= 1)
    {
      Circles = null;
      Lines = null;
      Print("MinR, MaxR must be positive and Num must be greater than 1");
      return;
    }
    
    // Remaining logic remains the same
    List<Circle> circleList = new List<Circle>();
    List<Line> lineList = new List<Line>();
    
    for(int i = 0; i < num; i++)
    {
      double factor = (double)i / (num - 1);
      double radius = minR + factor * (maxR - minR);
      double height = z * factor;
      Circle circle = new Circle(new Point3d(h, k, height), radius);
      circleList.Add(circle);
      
      if(i > 0)
      {
        int segments = 10;
        Circle prevCircle = circleList[i - 1];
        for(int j = 0; j < segments; j++)
        {
          double angle = 2 * Math.PI * j / segments;
          Point3d pt1 = prevCircle.PointAt(angle);
          Point3d pt2 = circle.PointAt(angle);
          Line line = new Line(pt1, pt2);
          lineList.Add(line);
        }
      }
    }
    
    Circles = circleList;
    Lines = lineList;
  }
}
# ---------- end circle_function_3 ----------
circle_function_4 = Script(h=number_slider_8, k=number_slider_10, r=number_slider_9)  # -> out, Circle; inputs h: Double, k: Double, r: Double; disabled
# ---------- circle_function_4: C# ----------
using System;
using System.Collections;
using System.Collections.Generic;
using System.Drawing;

using Rhino;
using Rhino.Geometry;

using Grasshopper;
using Grasshopper.Kernel;
using Grasshopper.Kernel.Data;
using Grasshopper.Kernel.Types;

public class Script_Instance : GH_ScriptInstance
{
  private void RunScript(double h, double k, double r, out object Circle)
  {
    // Verify if the radius is valid
    if(r <= 0)
    {
      Circle = null;
      Print("Radius must be a positive number.");
      return;
    }
    
    // Create a Circle from the provided center and radius.
    Circle = new Circle(new Point3d(h, k, 0), r);
  }
}
# ---------- end circle_function_4 ----------
geometry_6 = Geometry(circle_function_3.Circles)
geometry_7 = Geometry(circle_function_3.Lines)
panel_5 = Panel(circle_function_3.out)
panel_6 = Panel(circle_function_4.out)  # disabled
geometry_8 = Geometry(circle_function_4.Circle)  # disabled
entwine_3 = Entwine(Branch00=geometry_6, Branch01=geometry_7, FlattenInputs=True)
entwine_4 = Entwine(Branch00=geometry_8, FlattenInputs=True)  # disabled
panel_7 = Panel(entwine_3)
panel_8 = Panel(entwine_4)  # disabled
